# Grasshopper definition Tree pavilion Hops.gh (Grasshopper 1.0.8)

find_assemblies = GhPythonScript()  # -> out
# ---------- find_assemblies: Python ----------
import Grasshopper as gh

this = ghenv.Component
thisDoc = this.OnPingDocument()

asms = []

for obj in thisDoc.Objects:
    #print obj.GetType().BaseType
    
    #if obj.Obsolete: print 'Warning: Obsolete'
    #print 'Name: {}\nDescription: {}\nCategory: {} -> {}\n '.format(obj.Name, obj.Description, obj.Category, obj.SubCategory)
    #print 'Pivot: {} \t Bounds: {}'.format(obj.Attributes.Pivot, obj.Attributes.Bounds)
    
    asm = gh.Instances.ComponentServer.FindAssemblyByObject(obj.ComponentGuid)
    
    #print(x.IsCoreLibrary)
    if asm is not None and not asm.IsCoreLibrary:
        asms.append(asm.Name)
    
print asms
# ---------- end find_assemblies ----------
panel = Panel(find_assemblies)
seed = Slider(6, range=1..10)
number_of_trees = Slider(6, range=1..10)
size_multiplier = Slider(1.7, range=1..3)
tree_canopy_sides = Slider(15, range=5..20)
roof_s_sides_2 = Slider(6, range=2..10)
base_on_off = BooleanToggle(False)
roof_s_sides_2_2 = GetInteger(roof_s_sides_2, AtLeast=1, AtMost=1, Maximum=2147483647, Minimum=-2147483648, TreeAccess=False)
base_on_off_2 = GetBoolean(base_on_off, AtLeast=1, AtMost=1, FalseValue="False", TreeAccess=False, TrueValue="True")
base_text = GetString("BIM25 datamgmt", AtLeast=1, AtMost=1, TreeAccess=False)
tree_canopy_sides_2 = GetInteger(tree_canopy_sides, AtLeast=1, AtMost=1, Maximum=2147483647, Minimum=-2147483648, TreeAccess=False)
number_of_trees_2 = GetInteger(number_of_trees, AtLeast=1, AtMost=1, Maximum=2147483647, Minimum=-2147483648, TreeAccess=False)
seed_2 = GetInteger(seed, AtLeast=1, AtMost=1, Maximum=2147483647, Minimum=-2147483648, TreeAccess=False)
size_multiplier_2 = GetNumber(size_multiplier, AtLeast=1, AtMost=1, Maximum=1.797693135e+308, Minimum=-1.797693135e+308, TreeAccess=False)
division = Division(A="20", B=2)
multiplication = Multiplication(A=size_multiplier_2, B="2.5")
neg = Negative(Value=division)
xy = XYPlane(Origin=Point(0, 0, 0))
dom = ConstructDomain(DomainStart=neg, DomainEnd=division)
neg_2 = Negative(Value=size_multiplier_2)
rectangle = Rectangle(Plane=xy, XSize=dom, YSize=dom, Radius=0)  # -> Rectangle, Length

# ----
# Pavilion
panel_2 = Panel("4")
multiplication_2 = Multiplication(A=roof_s_sides_2_2, B=2)
neg_3 = Negative(Value=panel_2)
dom_2 = ConstructDomain(DomainStart=neg_3, DomainEnd=panel_2)
polygon = Polygon(Plane=xy, Radius=panel_2, Segments=multiplication_2, FilletRadius=0)  # -> Polygon, Length
rectangle_2 = Rectangle(Plane=xy, XSize=dom_2, YSize=dom_2, Radius=0)  # -> Rectangle, Length
Z = UnitZ(Factor="3.5")
move = Move(Geometry=polygon.Polygon, Motion=Z)  # -> Geometry, Transform
debrep = DeconstructBrep(Brep=move.Geometry)  # -> Faces, Edges, Vertices
panel_3 = Panel("""0
1""")
cull = CullPattern(List=debrep.Vertices, CullPattern=invert(panel_3))  # -> graft(List)
Z_2 = UnitZ(Factor=1)
area = Area(Geometry=debrep.Faces)  # -> Area, Centroid
cull_2 = CullPattern(List=debrep.Vertices, CullPattern=panel_3)
shift = ShiftList(List=flatten(cull), Shift=1, Wrap=True)  # -> graft(List)
move_2 = Move(Geometry=cull_2, Motion=Z_2)  # -> graft(Geometry), Transform
move_3 = Move(Geometry=area.Centroid, Motion=Z_2)  # -> Geometry, Transform
long = LongestList(ListA=cull, ListB=move_3.Geometry, PaddingMode=2)  # -> ListA, ListB
ln = Line(StartPoint=cull, EndPoint=move_3.Geometry)
curvepoint = PointOnCurve(ln, parameter=0.1)
srf4pt = _4PointSurface(CornerA=move_2.Geometry, CornerB=shift, CornerC=long.ListB)
srf4pt_2 = _4PointSurface(CornerA=move_2.Geometry, CornerB=cull, CornerC=long.ListB)
xy_2 = XYPlane(Origin=xy)
srf = Surface(rectangle_2.Rectangle)
cp = PlaneClosestPoint(Point=curvepoint, Plane=xy_2)  # -> Point, UVPoint, Distance
join = BrepJoin(Breps=flatten([srf4pt, srf4pt_2]))  # -> Breps, Closed
Z_3 = UnitZ(Factor="0.1")
ln_2 = Line(StartPoint=cp.Point, EndPoint=curvepoint)
Z_4 = UnitZ(Factor="0.15")
extr = Extrude(Base=join.Breps, Direction=Z_3)
pipe = Pipe(Curve=[ln_2, ln], Radius="0.05", Caps=2)  # -> flatten(Pipe)
extr_2 = Extrude(Base=srf, Direction=Z_4)
merge = Merge(Data1=extr, Data2=pipe, Data3=extr_2)
brep = Brep(merge)

offset = OffsetCurve(Curve=rectangle.Rectangle, Distance=neg_2, Corners=1)
offset_2 = OffsetCurve(Curve=rectangle_2.Rectangle, Distance=size_multiplier_2, Corners=1)
merge_2 = Merge(Data1=offset_2, Data2=offset)
boundary = BoundarySurfaces(Edges=merge_2)
popgeo = PopulateGeometry(Geometry=boundary, Count=number_of_trees_2, Seed=seed_2)
num = Number(expr("x+0.25", size_multiplier_2))
num_2 = Number(expr("x-0.25", size_multiplier_2))

# ----
# Base & Text
p_n_c = PickNChoose(Pattern=base_on_off_2, Stream0=rectangle.Rectangle)
neg_4 = Negative(Value="1")
Z_5 = UnitZ(Factor=neg_4)
move_4 = Move(Geometry=p_n_c, Motion=Z_5)  # -> Geometry, Transform
crv = Curve(p_n_c)
srf_2 = Surface(p_n_c)
extr_3 = Extrude(Base=srf_2, Direction=Z_5)
loft = Loft(
    Curves=[crv, move_4.Geometry],
    Options={Adjust=False, Closed=False, LoftEnds=0, LoftSimp=0, LoftType=0, Rebuild=10, Refit=0.01})
debrep_2 = DeconstructBrep(Brep=loft)  # -> Faces, Edges, Vertices
explode = Explode(Curve=debrep_2.Faces, Recursive=True)  # -> Segments, Vertices
midpt = CurveMiddle(Curve=explode.Segments)
pdecon = Deconstruct(Point=midpt)  # -> XComponent, YComponent, ZComponent
sort = SortList(Keys=pdecon.ZComponent, ValuesA=explode.Segments)  # -> Keys, ValuesA
item = ListItem(List=sort.ValuesA, Index=0, Wrap=True)  # -> Item, Item1, Item2
midpt_2 = CurveMiddle(Curve=item.Item2)
midpt_3 = CurveMiddle(Curve=item.Item1)
flip = Flip(Surface=debrep_2.Faces)  # -> graft(Surface), Result
ln_3 = Line(StartPoint=midpt_2, EndPoint=midpt_3)
textsrf = TextOnSurface(Text=base_text, Font="Sans Bold:no Italic:no", Height=1, Depth=0.4, BaseLine=ln_3, BaseSurface=flip.Surface)  # -> flatten(Symbols)
brep_2 = Brep(extr_3)
merge_3 = Merge(Data1=brep_2, Data2=textsrf)
brep_3 = Brep(merge_3)

dom_3 = ConstructDomain(DomainStart=num_2, DomainEnd=num)
range = Range(Domain=Domain(0, 1), Steps=10)
panel_4 = Panel(range)
context_print = ContextPrint(Values=range)
context_bake = ContextBake(BaseText=brep_3)
context_bake_2 = ContextBake(Pavilion=brep)

# ----
# Trees
pt = Point(popgeo)
num_3 = Number(expr("x+1", multiplication))
num_4 = Number(expr("x-1", multiplication))
lng = ListLength(List=pt)
dom_4 = ConstructDomain(DomainStart=num_4, DomainEnd=num_3)
random = Random(Range=dom_4, Number=lng, Seed=2)  # -> graft(Random)
series = Series(Start=0, Step=1, Count=lng)  # -> graft(Series)

random_2 = Random(Range=dom_3, Number=lng, Seed=2)  # -> graft(Random)
num_5 = Number(random)
num_6 = Number(random_2)

Z_6 = UnitZ(Factor=num_5)
move_5 = Move(Geometry=graft(pt), Motion=Z_6)  # -> Geometry, Transform
cyl = Cylinder(Base=graft(pt), Radius=expr("x/35", num_5), Length=num_5)
box = CenterBox(Base=move_5.Geometry, X=num_6, Y=num_6, Z=num_6)
pop3d = Populate3D(Region=box, Count=tree_canopy_sides_2, Seed=series)  # -> simplify(Population)
facet = FacetDome(Points=pop3d)  # -> Pattern, Dome
boundary_2 = BoundarySurfaces(Edges=facet.Pattern)
join_2 = BrepJoin(Breps=boundary_2)  # -> Breps, Closed
sint = SolidIntersection(BrepsA=box, BrepsB=join_2.Breps)
brep_4 = Brep(cyl)
merge_4 = Merge(Data1=brep_4, Data2=sint)  # -> flatten(Result)
brep_5 = Brep(merge_4)

context_bake_3 = ContextBake(Content=brep_5)
